# Grasshopper definition Rhino_to_STL.gh (Grasshopper 1.0.8)

# ---- group: 1.部屋ボリュームを指定
# 部屋ボリュームからSTLファイルへの変換
ko = Brep([<brep referenced from the Rhino model> x17])

# ---- group: 2.番号に対応する部屋を確認
# ↓
# ↓この範囲を確認して名前を設定
# ↓
lng = ListLength(List=ko)  # -> expr("x-1", Length)
domain = Domain(lng)
オブジェクト番号 = Slider(4, range=0..20)
panel = Panel(domain)
item = ListItem(List=ko, Index=オブジェクト番号, Wrap=True)
preview = CustomPreview(Geometry=item, Material=ColourSwatch(SwatchColor=RGB(255, 0, 0)))

# ---- group: 3.番号と室名を紐づけ
番号と室名を対応させる = Panel("""洋室2
洋室1
吹抜
WCL
主寝室
ホール
小屋裏
洗面室
玄関
階段
LDK
階間
SCL
トイレ
AC2F
AC1F
床下""")
cluster = Cluster(L=番号と室名を対応させる, i=オブジェクト番号)
panel_2 = Panel(cluster)

# ---- group: 4.STL形式で書き出し
出力先のフォルダのパスを指定_あらかじめ作成しておく = Panel("C:\dummy")
trueにして実行 = BooleanToggle(False)
py3 = Python3Script(Geometries=ko, Names=番号と室名を対応させる, FolderPath=出力先のフォルダのパスを指定_あらかじめ作成しておく, Run=trueにして実行)  # inputs Geometries: list of Brep, Names: list of String, FolderPath: String, Run: Boolean
# ---------- py3: Python ----------
import Rhino
import os
import System

def export_stl(geometries, names, folder_path):
    # フォルダが存在しなければ作成
    if not os.path.exists(folder_path):
        raise ValueError("指定したパスが存在しません: {}".format(folder_path))

    for geo, name in zip(geometries, names):
        export_meshes = []
        
        # 1. Brep（Polysurface）の場合はMeshに変換
        if isinstance(geo, Rhino.Geometry.Brep):
            mp = Rhino.Geometry.MeshingParameters.Default
            meshes = Rhino.Geometry.Mesh.CreateFromBrep(geo, mp)
            if meshes:
                export_meshes.extend(meshes)
                
        # 2. すでにMeshの場合はそのままリストに追加
        elif isinstance(geo, Rhino.Geometry.Mesh):
            export_meshes.append(geo)
            
        else:
            print("エラー: ジオメトリではないか、未対応の形式です ({})".format(name))
            continue
            
        if not export_meshes:
            print("エラー: メッシュ化に失敗しました ({})".format(name))
            continue
            
        # 3. 複数のメッシュに分かれている場合は1つに結合
        final_mesh = Rhino.Geometry.Mesh()
        for m in export_meshes:
            final_mesh.Append(m)
            
        # 4. STLとして書き出し
        file_path = os.path.join(folder_path, "{}.stl".format(name))
        
        # --- ここから修正部分 ---
        # 仮想のドキュメント(Headless Doc)を作成し、メッシュを追加
        doc = Rhino.RhinoDoc.CreateHeadless("")
        doc.Objects.AddMesh(final_mesh)
        
        # STLの書き出しオプション
        write_options = Rhino.FileIO.FileStlWriteOptions()
        
        # 仮想ドキュメントごとSTLとして書き出す
        success = Rhino.FileIO.FileStl.Write(file_path, doc, write_options)
        
        # メモリの無駄遣いを防ぐため、書き出し終わった仮想ドキュメントを破棄
        doc.Dispose()
        # --- 修正部分ここまで ---
        
        if success:
            print("✅ 書き出し成功: {}".format(file_path))
        else:
            print("❌ 書き出し失敗: {}".format(file_path))

# --- メイン処理 ---
if Run and Geometries and Names and FolderPath:
    if len(Geometries) == len(Names):
        export_stl(Geometries, Names, FolderPath)
    else:
        print("エラー: ジオメトリの数（{}）と名前の数（{}）が一致していません！".format(len(Geometries), len(Names)))
else:
    print("RunをTrueにするか、入力データを確認してください。")
# ---------- end py3 ----------

# ==== cluster Cluster
L = ClusterInput()
i = ClusterInput()
item = ListItem(List=L, Index=i, Wrap=True)
concat = Concatenate(FragmentC="現在表示中の部屋は「", FragmentA=item, FragmentB="」です")
R = ClusterOutput(concat)
